# Grasshopper definition RhinoPython_Fractal_Tree_for_GH.gh (Grasshopper 1.0.7)

# ---- group: 設計変数
# 0. Gene
gene_pool = GenePool(
    Decimals=1,
    Maximum=1,
    Minimum=0,
    Value=[0.8672650363, 0.04161744008, 0.195283319, 0.008335141003, 0.8503912328, 0.3968927215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])

# ---- group: Generation
# 1. Generation Phase
number_slider = Slider(6, range=1..10)
file_path = FilePath("C:\Users\sho\Desktop\RhinoPython_Optimization_of_Fractal_Tree_for_GH\generation.py")
generation_py = GhPythonScript(Code=file_path, MaxN=number_slider, AngleXZGene=gene_pool)  # -> Out, AllAxis, AllText, AllNoPt, AllBranch, AllBranchSrf, AllLeaf
panel = Panel(generation_py.Out)
text_tag_3d = TextTag3D(Location=generation_py.AllNoPt, Text=generation_py.AllText, Size=Slider(75, range=0..1000), Justification=7)
allbranchsrf = Geometry(generation_py.AllBranchSrf)
allbranch = Geometry(generation_py.AllBranch)

# ----
geometry = Geometry(generation_py.AllAxis)

xy_plane = XYPlane(Origin="{5000,-6000,1}")
legendpar = LBLegendParameters(
    min=Slider(0, range=0..24),
    max=Slider(24, range=0..24),
    seg_count="25",
    base_plane=xy_plane,
    seg_height="450",
    seg_width="600",
    text_height="150")  # -> leg_par; plug-in component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
panel_2 = Panel(legendpar)

file_path_2 = FilePath("C:\Users\sho\Desktop\RhinoPython_Optimization_of_Fractal_Tree_for_GH\record.py")

# ---- group: Optimization
# 3. Optimization
galapagos = Galapagos(fitness=evaluation_py, gene=gene_pool)

# ---- group: SunPath
file_path_3 = FilePath("C:\Users\sho\Desktop\RhinoPython_Optimization_of_Fractal_Tree_for_GH\JPN_Tokyo.Hyakuri.477150_IWEC.epw")
# 2. Evaluation
importepw = LBImportEPW(epw_file=file_path_3)  # -> location, dry_bulb_temperature, dew_point_temperature, relative_humidity, wind_speed, wind_direction, direct_normal_rad, diffuse_horizontal_rad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; plug-in component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
analysisperiod = LBAnalysisPeriod(
    start_month=Slider(3, range=1..12),
    start_day=Slider(21, range=1..28),
    start_hour=Slider(6, range=0..23),
    end_month=Slider(3, range=1..12),
    end_day=Slider(21, range=1..28),
    end_hour=Slider(18, range=0..23))  # -> period, hoys, dates; plug-in component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
analysisperiod_2 = LBAnalysisPeriod(
    start_month=Slider(6, range=1..12),
    start_day=Slider(21, range=1..28),
    start_hour=Slider(6, range=0..23),
    end_month=Slider(6, range=1..12),
    end_day=Slider(21, range=1..28),
    end_hour=Slider(18, range=0..23))  # -> period, hoys, dates; plug-in component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
sunpath = LBSunPath(location=importepw.location, hoys=[analysisperiod_2.hoys, analysisperiod.hoys], scale="0.1")  # -> out, vectors, altitudes, azimuths, hoys, sun_pts, analemma, daily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; plug-in component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
datetime = LBHOYToDateTime(hoy=sunpath.hoys)  # -> month, day, hour, minute, date; plug-in component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
text_tag_3d_2 = TextTag3D(Location=sunpath.sun_pts, Text=datetime.date, Size="200", Justification=7)

# ----
allleaf = Geometry(generation_py.AllLeaf)
障害物 = Geometry([<brep referenced from the Rhino model> x2])
directsunhours = LBDirectSunHours(
    vectors=flatten(sunpath.vectors),
    geometry=flatten(allleaf),
    context=flatten([障害物, allleaf]),
    grid_size="300",
    offset_dist="1",
    legend_par=legendpar,
    run=Toggle(True))  # -> out, points, results, mesh, legend, title, int_mtx; plug-in component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
file_path_4 = FilePath("C:\Users\sho\Desktop\RhinoPython_Optimization_of_Fractal_Tree_for_GH\evaluation.py")
evaluation_py = GhPythonScript(Code=file_path_4, Values=directsunhours.results)  # -> Out, Fitness
panel_3 = Panel(evaluation_py.Out)

# ---- group: Record
# 4. Record
data_recorder_fitnesses = DataRecorder(evaluation_py.Fitness, DataLimit=-1000, RecordData=False)
data_recorder_anglexzs = DataRecorder(gene_pool, DataLimit=-1000, RecordData=False)
record_py = GhPythonScript(Code=file_path_2, Fitnesses=data_recorder_fitnesses, AngleXZs=data_recorder_anglexzs, No=Slider(0, range=0..908))  # -> Out, Dic, Fitness, AngleXZGene
panel_4 = Panel(record_py.Out)

# ---- group: 描画
# 5. Redraw
number_slider_2 = Slider(6, range=1..10)  # disabled
file_path_5 = FilePath("C:\Users\sho\Desktop\RhinoPython_Fractal_Tree_for_GH_new\generation.py")  # disabled
genaration_py = GhPythonScript(Code=file_path_5, MaxN=number_slider_2, AngleXZGene=record_py.AngleXZGene)  # -> Out, AllText, AllNoPt, AllBranch, AllLeaf; disabled
number_slider_3 = Slider(100, range=0..1000)  # disabled
panel_5 = Panel(genaration_py.Out)  # disabled
geometry_2 = Geometry(genaration_py.AllBranch)  # disabled
text_tag_3d_3 = TextTag3D(Location=genaration_py.AllNoPt, Text=genaration_py.AllText, Size=number_slider_3, Justification=7)  # disabled

# ----
allleaf_record = Geometry(genaration_py.AllLeaf)
